# Grasshopper definition sumList.gh (Grasshopper 1.0.7)

panel = Panel("""2.0
1.0
0.5""")
crv = Curve(<curve referenced from the Rhino model>)
panel_2 = Panel("""5
3
5""")
dup = DuplicateData(Data=panel, Number=Slider(5, range=0..10), Order=Toggle(True))
panel_3 = Panel(dup)
python = GhPythonScript(L=panel_2)  # -> nL; inputs L: list
# ---------- python: Python ----------
import rhinoscriptsyntax as rs
from Grasshopper.Kernel import GH_RuntimeMessageLevel as rel
nL = []
nL = [L[i]+sum(L[:i]) for i in range(len(L))]
# ---------- end python ----------
panel_4 = Panel(python)
jitter = Jitter(List=dup, Jitter=Slider(0.5, range=0..1), Seed=2)  # -> Values, Indices
panel_5 = Panel(jitter.Values)
python_2 = GhPythonScript(L=jitter.Values)  # -> nL; inputs L: list; same code as python
panel_6 = Panel(python_2)
eval = EvaluateCurve(Curve=crv, Parameter=python_2)  # -> Point, Tangent, Angle
